# Grasshopper definition twist, levels, floors.gh (Grasshopper 1.0.7)
# plug-ins: Rhino.Inside for Autodesk Revit

floor_height = Slider(4393, range=0..10000)
no_floors = Slider(32, range=0..50)
total_twist = Slider(57, range=0..360)
# Set this to the shape of choice from Rhino
curve = Curve(<curve referenced from the Rhino model>)
series = Series(Start=0, Step=floor_height, Count=no_floors)
unit_z = UnitZ(Factor=series)
range = Range(Domain=Slider(0.99, range=0..1), Steps=no_floors)
move = Move(Geometry=curve, Motion=unit_z)  # -> Geometry, Transform
graph_mapper = GraphMapper(
    range,
    x0=0,
    x1=1,
    y0=0,
    y1=1,
    container_name="Bezier",
    cpx=[0, 0.4874936044, 0.978249073, 1],
    cpy=[0.752473712, 1, 0.8184850216, 0.3016602397])
area = Area(Geometry=move.Geometry)  # -> Area, Centroid
subtraction = Subtraction(A=no_floors, B="1")
scale = Scale(Geometry=move.Geometry, Center=area.Centroid, Factor=graph_mapper)  # -> Geometry, Transform
range_2 = Range(Domain=subtraction, Steps=subtraction)
bounds = Bounds(Numbers=range)
construct_domain = ConstructDomain(DomainStart="0", DomainEnd="1")
format = Format(Format="Level {0}", Culture=127, Data0=range_2)
remap_numbers = RemapNumbers(Value=range, Source=bounds, Target=construct_domain)  # -> Mapped, Clipped
multiplication = Multiplication(A=total_twist, B=remap_numbers.Mapped)
rotate = Rotate(Geometry=scale.Geometry, Angle=degrees(multiplication), Plane=area.Centroid)  # -> graft(Geometry), Transform
# Delete this type and create a new one.
# 
# Then right-click it and set it the the floor type of choice.
type = Type(<hostobjecttype referenced from the Revit model>, SelectedBuiltInCategory="autodesk.revit.category.local:floors")
# Connect Boundary to Boundary
data_dam = DataDam(DataDataA=rotate.Geometry, DataA=type, DataB=Toggle(True), BufferDelay=10000000, BufferMode=0)  # -> DataBoundary, DataType, DataB
# Connect Boundary to Boundary
data_dam_2 = DataDam(DataDataA=series, DataA=format, DataB=Toggle(True), BufferDelay=10000000, BufferMode=0)  # -> DataElevation, DataName, DataToggle
add_level = AddLevel(Name=data_dam_2.DataName, TrackingMode=2)
add_floor = AddFloor(Type=data_dam.DataType, Level=add_level, Structural=Toggle(True), TrackingMode=2)
